# Grasshopper definition shoebox.gh (Grasshopper 1.0.7)

# ---- group: Toggle "True"
boolean_toggle = BooleanToggle(False)

# ----
# INPUTS
# Building parameters
# Shoebox curve input
number_of_floors = Slider(4, range=0..100)
floor_to_floor_height_m = Slider(52, range=50..80, expression="x*0.05")
curve = Curve([<curve referenced from the Rhino model> x34])

# ---- group: Toggle "True"
boolean_toggle_2 = BooleanToggle(True)

# ----
timer = Timer(TimerInterval=5000, Target=sender)
timer_2 = Timer(TimerInterval=5000, Target=receiver)  # disabled

get_parcels = GhPythonScript()  # -> Out, A

# ---- group: Web-server input/output
sender = GhPythonScript(x=curve, y=boolean_toggle_2)  # -> out, a; inputs x: list
# ---------- sender: Python ----------
__author__ = "drago"
__version__ = "2020.06.01"

import rhinoscriptsyntax as rs
import webbrowser
import System.Net.WebRequest as req
import System.IO.StreamReader as reader
import System.IO.StreamWriter as writer
import json

nodes = []
edges = []
int = []
#####find floorplan lines and centroids
start = 2
if y:
    for i in x:
        node = {"id":"","roomtype":"","floorArea":"","walls":[],"center":[]}
        points = []
        for j in rs.CurveEditPoints(i):
            points.append(list(j))
        node["id"] = start
        node["center"] = list(rs.CurveAreaCentroid(i)[0])
        node["walls"] =  points
        node["floorArea"] = rs.CurveArea(i)[0]
        nodes.append(node)
        start += 1
    #####find intersections between curves
    for c in range(0,len(x)-1):
        x1 = x[c::]

        for k in range(0,len(x1)-1):
            intersect = rs.CurveCurveIntersection(x1[0],x1[k+1])
            if intersect != None:
                if intersect[0][0] == 2:
                    holder = str(c+2)+"/"+str(c+2+k+1)
                    print(holder)
                    #edge["edgeId"]=holder
                    edge = {"edgeId":holder,"isAccessible":True,"adjWalls":[]}
                    v = [list(intersect[0][1]),list(intersect[0][2])]
                    edges.append(edge)
                    int.append(v)
    
    json_dict = {"nodes":nodes,"int":int,"edges":edges}
    print(edges)
    a = json.dumps(json_dict)
    try:
        httpreq = req.Create("http://localhost:5000/req/")
        httpreq.ContentType = "application/json"
        httpreq.Method = "POST"
        httpwrite = writer(httpreq.GetRequestStream())
        httpreq.Timeout = 1000
        httpwrite.Write(a)
        httpwrite.Close()
        httpresponse = httpreq.GetResponse()
        print(httpresponse)
    except:
        pass
    
    a = nodes[0]["walls"]
# ---------- end sender ----------
receiver = GhPythonScript(y=boolean_toggle, levels=number_of_floors, height=floor_to_floor_height_m)  # -> c, fc, gwpfinal, gwpPerM2, normgwp, mat_values, mat_keys, mat_values_n
# ---------- receiver: Python ----------
__author__ = "drago"
__version__ = "2020.06.25"

import rhinoscriptsyntax as rs
import time
import json
import System.Net.WebClient as WebClient

if y:

    client = WebClient()
    content = client.DownloadString("http://localhost:5000/get/")
    output = json.loads(content)
    
    mat_array = output[0]
    mat_breakdown = {}
    for m in mat_array:
        mat_breakdown[m] = 0        #per floor
    output = output[1]
    c = []                          #wall curves
    gwp = []                        #
    fc = []
    gwp_fc = []                     #floor curves
    gwplocalm2 =[]                  #localized gwp/m2
    gwp_sum_floor = 0               #gwp sum per floor
    area_sum_floor = 0              #area sum per floor
    gwp_sum_area = 0
    levels = int(levels)
        
    for i in range(0,len(output)):
        area = output[i]["floorArea"]
        area_sum_floor += area
        try:
            north_wall = output[i]["wall_N"]["vertices"]
            north_mat = output[i]["wall_N"]["material"]
            north_gwp = output[i]["wall_N"]["GWP"]
            gwp_sum_floor += sum(north_gwp)
            for m in range(0,len(north_mat)):
                mat_breakdown[north_mat[m]] += north_gwp[m]
            for j in range(0,len(north_wall)):
                if north_wall[j][0]==north_wall[j][1]:
                    pass
                else:
                    gwplocalm2.append(north_gwp[j]/area)
                    start = north_wall[j][0]
                    end = north_wall[j][1]
                    for k in range(0,levels):
                        start[2] = k*height 
                        end[2] = k*height
                        c.append(rs.AddPolyline([start,end]))
                        gwp.append(north_gwp[j]/area)
        except:
            pass
        
        try:
            south_wall = output[i]["wall_S"]["vertices"]
            south_mat = output[i]["wall_S"]["material"]
            south_gwp = output[i]["wall_S"]["GWP"]
            gwp_sum_floor += sum(south_gwp)
            for m in range(0,len(south_mat)):
                mat_breakdown[south_mat[m]] += south_gwp[m]
            for j in range(0,len(south_wall)):
                if south_wall[j][0]==south_wall[j][1]:
                    pass
                else:
                    gwplocalm2.append(south_gwp[j]/area)
                    start = south_wall[j][0]
                    end = south_wall[j][1]
                    for k in range(0,levels):
                        start[2] = k*height 
                        end[2] = k*height
                        c.append(rs.AddPolyline([start,end]))
                        gwp.append(south_gwp[j]/area)
        except:
            pass
        
        try:
            west_wall = output[i]["wall_W"]["vertices"]
            west_mat = output[i]["wall_W"]["material"]
            west_gwp = output[i]["wall_W"]["GWP"]
            gwp_sum_floor += sum(west_gwp)
            for m in range(0,len(west_mat)):
                mat_breakdown[west_mat[m]] += west_gwp[m]
            for j in range(0,len(west_wall)):
                if west_wall[j][0]==west_wall[j][1]:
                    pass
                else:
                    gwplocalm2.append(west_gwp[j]/area)
                    start = west_wall[j][0]
                    end = west_wall[j][1]
                    for k in range(0,levels):
                        start[2] = k*height 
                        end[2] = k*height
                        c.append(rs.AddPolyline([start,end]))
                        gwp.append(west_gwp[j]/area)
        except:
            pass
                    
        try:
            east_wall = output[i]["wall_E"]["vertices"]
            east_mat = output[i]["wall_E"]["material"]
            east_gwp = output[i]["wall_E"]["GWP"]
            gwp_sum_floor += sum(east_gwp)
            for m in range(0,len(east_mat)):
                mat_breakdown[east_mat[m]] += east_gwp[m]
            for j in range(0,len(east_wall)):
                if east_wall[j][0]==east_wall[j][1]:
                    pass
                else:
                    gwplocalm2.append(east_gwp[j]/area)
                    start = east_wall[j][0]
                    end = east_wall[j][1]
                    for k in range(0,levels):
                        start[2] = k*height 
                        end[2] = k*height
                        c.append(rs.AddPolyline([start,end]))
                        gwp.append(east_gwp[j]/area)
        except:
            pass
                    
                    
        for k in range(0,levels):
            try:
                floor = output[i]["walls"]
                for j in floor:
                    j[2] = (k+1)*height
                fc.append(rs.AddPolyline(floor))
                gwp_fc.append(output[i]["floorGWP"]/area)
            except:
                pass
                
print(mat_breakdown)
gwp_per_m2 = gwp+gwp_fc         ###localized gwp per m2
min_gwpm2 = min(gwp_per_m2)
max_gwpm2 = max(gwp_per_m2)
normgwp = [(x-min_gwpm2)/(max_gwpm2-min_gwpm2) for x in gwp_per_m2]
gwpfinal = gwp_sum_floor*levels
gwpPerM2 = gwp_sum_floor/area_sum_floor

mat_keys = mat_breakdown.keys()
mat_keys = [str(mat_keys.index(x))+": "+str(x) for x in mat_keys]
mat_values = mat_breakdown.values()
mat_values_n = [(x-min(mat_values))/(max(mat_values)-min(mat_values)) for x in mat_values]
# ---------- end receiver ----------

# ----
unit_z = UnitZ(Factor=floor_to_floor_height_m)
extrude = Extrude(Base=receiver.c, Direction=unit_z)  # -> flatten(Extrusion)
partition_list = PartitionList(List=receiver.fc, Size=1)
patch = Patch(Curves=partition_list, Spans=20, Flexibility=1, Trim=True)  # -> flatten(Patch)

# ----
# OUTPUTS
gwp_per_floor_area_kgco2eq_m2 = Panel(receiver.gwpPerM2)
gradient = Gradient(
    LowerLimit=0,
    UpperLimit=1,
    Parameter=receiver.normgwp,
    stops=[0: RGBA(0, 128, 0, 120), 0.5: RGBA(255, 255, 0, 120), 1: RGBA(255, 0, 0, 120)])
custom_preview = CustomPreview(Geometry=[extrude, patch], Material=gradient)

total_gwp_kgco2eq_m2 = Panel(receiver.gwpfinal)
gradient_2 = Gradient(
    LowerLimit=0,
    UpperLimit=1,
    Parameter=receiver.mat_values_n,
    stops=[0: RGBA(0, 128, 0, 120), 0.5: RGBA(255, 255, 0, 120), 1: RGBA(255, 0, 0, 129)])
legend = Legend(Colour=gradient_2, Tags=receiver.mat_keys, LegendType=101)

# ---- group: Toggle True
bake_with_attributes = BooleanToggle(False)

# ----
# BAKE BUILDING OBJECT WITH VISUALISATION
specify_rhinoceros_layer_to_bake_to = Panel("layer 02")
bakeattributes = CSharpScript(
    objs=[extrude, patch],
    layers=specify_rhinoceros_layer_to_bake_to,
    colors=gradient,
    activate=bake_with_attributes,
    groupListTgthr=Toggle(False))  # -> out; inputs objs: list, names: list of String, layers: list of String, colors: list of Color, pWidths: list of Double, wiresEach: list of Int32, materials: list, activate: Boolean, groupListTgthr: Boolean
# ---------- bakeattributes: C# usings ----------
using System.IO;
using System.Linq;
using System.Data;
using System.Drawing;
using System.Reflection;
using System.Windows.Forms;
using System.Xml;
using System.Xml.Linq;
using System.Runtime.InteropServices;

using Rhino.DocObjects;
using Rhino.Collections;
using GH_IO;
using GH_IO.Serialization;
# ---------- bakeattributes: C# ----------
    //Inserts geometry into the Rhino document, with custom attributes
    //Written by Giulio Piacentino
    //Version written 2011 10 18 - for Grasshopper 0.8.52

    if (activate)
    {
      int groupIndex = -1;
      if(groupListTgthr)
        groupIndex = doc.Groups.Add();

      for(int i = 0; i < objs.Count; i++)
      {
        object obj = objs[i];
        if(obj == null)
        {
          Print("No object to bake");
          return;
        }

        //Make new attribute to set name
        Rhino.DocObjects.ObjectAttributes att = new Rhino.DocObjects.ObjectAttributes();

        string name = names.Count > 0 ? names[i % names.Count] : null;
        //Set object name
        if(!string.IsNullOrEmpty(name))
        {
          att.Name = name;
        }

        Color color = colors.Count > 0 ? colors[i % colors.Count] : new Color();
        //Set color
        if(!color.IsEmpty)
        {
          att.ColorSource = Rhino.DocObjects.ObjectColorSource.ColorFromObject; //Make the color type "by object"
          att.ObjectColor = color;

          att.PlotColorSource = Rhino.DocObjects.ObjectPlotColorSource.PlotColorFromObject; //Make the plot color type "by object"
          att.PlotColor = color;
        }

        string layer = layers.Count > 0 ? layers[i % layers.Count] : null;
        //Set layer
        if(!string.IsNullOrEmpty(layer) && Rhino.DocObjects.Layer.IsValidName(layer))
        {
          //Get the current layer index
          Rhino.DocObjects.Tables.LayerTable layerTable = doc.Layers;
          int layerIndex = layerTable.Find(layer, true);

          if(layerIndex < 0) //This layer does not exist, we add it
          {
            Rhino.DocObjects.Layer onlayer = new Rhino.DocObjects.Layer(); //Make a new layer
            onlayer.Name = layer;

            layerIndex = layerTable.Add(onlayer); //Add the layer to the layer table
            if (layerIndex > -1) //We manged to add layer!
            {
              att.LayerIndex = layerIndex;
              Print("Added new layer to the document at position " + layerIndex + " named " + layer + ". ");
            } else
              Print("Layer did not add. Try cleaning up your layers."); //This never happened to me.
          }
          else
            att.LayerIndex = layerIndex; //We simply add to the existing layer
        }


        double pWidth = pWidths.Count > 0 ? pWidths[i % pWidths.Count] : 0;
        //Set plotweight
        if(pWidth > 0)
        {
          att.PlotWeightSource = Rhino.DocObjects.ObjectPlotWeightSource.PlotWeightFromObject;
          att.PlotWeight = pWidth;
        }


        object material = materials.Count > 0 ? materials[i % materials.Count] : null;
        //Set material
        bool materialByName = !string.IsNullOrEmpty(material as string);
        Rhino.Display.DisplayMaterial inMaterial = material as Rhino.Display.DisplayMaterial;
        if(material is Color)
        {
          inMaterial = new Rhino.Display.DisplayMaterial((Color) material);
        }
        if(material != null && inMaterial == null && !materialByName)
        {
          if(!(material is string))
          {
            try //We also resort to try with IConvertible
            {
              inMaterial = (Rhino.Display.DisplayMaterial) Convert.ChangeType(material, typeof(Rhino.Display.DisplayMaterial));
            }
            catch(InvalidCastException)
            {
            }
          }
        }
        if(inMaterial != null || materialByName)
        {
          string matName;

          if(!materialByName)
          {
            matName = string.Format("A:{0}-D:{1}-E:{2}-S:{3},{4}-T:{5}",
              Format(inMaterial.Ambient),
              Format(inMaterial.Diffuse),
              Format(inMaterial.Emission),
              Format(inMaterial.Specular),
              inMaterial.Shine.ToString(),
              inMaterial.Transparency.ToString()
              );
          }
          else
          {
            matName = (string) material;
          }

          int materialIndex = doc.Materials.Find(matName, true);
          if(materialIndex < 0 && !materialByName) //Material does not exist and we have its specs
          {
            materialIndex = doc.Materials.Add(); //Let's add it
            if(materialIndex > -1)
            {
              Print("Added new material at position " + materialIndex + " named \"" + matName + "\". ");
              Rhino.DocObjects.Material m = doc.Materials[materialIndex];
              m.Name = matName;
              m.AmbientColor = inMaterial.Ambient;
              m.DiffuseColor = inMaterial.Diffuse;
              m.EmissionColor = inMaterial.Emission;
              //m.ReflectionColor = no equivalent
              m.SpecularColor = inMaterial.Specular;
              m.Shine = inMaterial.Shine;
              m.Transparency = inMaterial.Transparency;
              //m.TransparentColor = no equivalent
              m.CommitChanges();

              att.MaterialSource = Rhino.DocObjects.ObjectMaterialSource.MaterialFromObject;
              att.MaterialIndex = materialIndex;
            }
            else
              Print("Material did not add. Try cleaning up your materials."); //This never happened to me.
          }
          else if(materialIndex < 0 && materialByName) //Material does not exist and we do not have its specs. We do nothing
          {
            Print("Warning: material name not found. I cannot set the source to this material name. Add a material with name: " + matName);
          }
          else
          {
            //If this material exists, we do not replace it!
            att.MaterialSource = Rhino.DocObjects.ObjectMaterialSource.MaterialFromObject;
            att.MaterialIndex = materialIndex;
          }
        }


        int wires = wiresEach.Count > 0 ? wiresEach[i % wiresEach.Count] : 0;
        //Set wire density
        if(wires == -1 || wires > 0)
        {
          att.WireDensity = wires;
        }

        Bake(obj, att, groupIndex);
      }
    }
    else
    {
      Print("Inactive");
    }
# ---------- bakeattributes: C# additional code ----------
  void Bake(object obj, Rhino.DocObjects.ObjectAttributes att, int groupIndex)
  {
    if(obj == null)
      return;

    Guid id;

    //Bake to the right type of object
    if(obj is GeometryBase)
    {
      GeometryBase geomObj = obj as GeometryBase;

      switch(geomObj.ObjectType)
      {
        case Rhino.DocObjects.ObjectType.Brep:
          id = doc.Objects.AddBrep(obj as Brep, att);
          break;
        case Rhino.DocObjects.ObjectType.Curve:
          id = doc.Objects.AddCurve(obj as Curve, att);
          break;
        case Rhino.DocObjects.ObjectType.Point:
          id = doc.Objects.AddPoint((obj as Rhino.Geometry.Point).Location, att);
          break;
        case Rhino.DocObjects.ObjectType.Surface:
          id = doc.Objects.AddSurface(obj as Surface, att);
          break;
        case Rhino.DocObjects.ObjectType.Mesh:
          id = doc.Objects.AddMesh(obj as Mesh, att);
          break;
        case (Rhino.DocObjects.ObjectType) 1073741824://Rhino.DocObjects.ObjectType.Extrusion:
          id = (Guid) typeof(Rhino.DocObjects.Tables.ObjectTable).InvokeMember("AddExtrusion", BindingFlags.Instance | BindingFlags.InvokeMethod, null, doc.Objects, new object[]{obj, att});
          break;
        case Rhino.DocObjects.ObjectType.PointSet:
          id = doc.Objects.AddPointCloud(obj as Rhino.Geometry.PointCloud, att); //This is a speculative entry
          break;
        default:
          Print("The script does not know how to handle this type of geometry: " + obj.GetType().FullName);
          return;
      }
    }
    else
    {
      Type objectType = obj.GetType();

      if(objectType == typeof(Arc))
      {
        id = doc.Objects.AddArc((Arc) obj, att);
      }
      else if(objectType == typeof(Box))
      {
        id = doc.Objects.AddBrep(((Box) obj).ToBrep(), att);
      }
      else if(objectType == typeof(Circle))
      {
        id = doc.Objects.AddCircle((Circle) obj, att);
      }
      else if(objectType == typeof(Ellipse))
      {
        id = doc.Objects.AddEllipse((Ellipse) obj, att);
      }
      else if(objectType == typeof(Polyline))
      {
        id = doc.Objects.AddPolyline((Polyline) obj, att);
      }
      else if(objectType == typeof(Sphere))
      {
        id = doc.Objects.AddSphere((Sphere) obj, att);
      }
      else if(objectType == typeof(Point3d))
      {
        id = doc.Objects.AddPoint((Point3d) obj, att);
      }
      else if(objectType == typeof(Line))
      {
        id = doc.Objects.AddLine((Line) obj, att);
      }
      else if(objectType == typeof(Vector3d))
      {
        Print("Impossible to bake vectors");
        return;
      }
      else if(obj is IEnumerable)
      {
        int newGroupIndex;
        if(groupIndex == -1)
          newGroupIndex = doc.Groups.Add();
        else
          newGroupIndex = groupIndex;
        foreach(object o in obj as IEnumerable)
        {
          Bake(o, att, newGroupIndex);
        }
        return;
      }
      else
      {
        Print("Unhandled type: " + objectType.FullName);
        return;
      }
    }

    if(groupIndex != -1)
    {
      doc.Groups.AddToGroup(groupIndex, id);
      Print("Added " + obj.GetType().Name + " to group number " + groupIndex);
    }
    else
      Print("Added " + obj.GetType().Name);
  }

  static string Format(Color c)
  {
    return (new System.Text.StringBuilder("A")).Append(c.A.ToString()).Append("R").Append(c.R.ToString()).Append("G")
      .Append(c.G.ToString()).Append("B").Append(c.B.ToString()).ToString();
  }
# ---------- end bakeattributes ----------

material_gwp_in_building_kgco2eq_m2 = Panel(receiver.mat_values)
