# Grasshopper definition test.gh (Grasshopper 1.0.7)

curve = Curve([<curve referenced from the Rhino model> x4])
send_data = GhPythonScript(x=curve, y=Toggle(False))  # -> out, b, a; inputs x: list
# ---------- send_data: Python ----------
__author__ = "drago"
__version__ = "2020.06.01"

import rhinoscriptsyntax as rs
import webbrowser
import System.Net.WebRequest as req
import System.IO.StreamReader as reader
import System.IO.StreamWriter as writer
import json

b = rs.CurveEditPoints(x[1])
if y:
    fp = []
    for i in x:
        points = []
        for j in rs.CurveEditPoints(i):
            points.append(list(j))
        fp.append(points)
    a = json.dumps(fp)
    
    try:
        httpreq = req.Create("http://localhost:5000/req/")
        httpreq.ContentType = "application/json"
        httpreq.Method = "POST"
        httpwrite = writer(httpreq.GetRequestStream())
        httpreq.Timeout = 1000
        httpwrite.Write(a)
        httpwrite.Close()
        httpresponse = httpreq.GetResponse()
        print(httpresponse)
    except:
        pass
    
    #print(a)
    
    #out = rs.CurveCurveIntersection(x[0],x[1])
    
    
    url = "http://localhost:5000/"
    #MacOS
    #chrome_path = 'open -a /Applications/Google\ Chrome.app %s'
    #windows
    chrome_path = 'C:/Program Files (x86)/Google/Chrome/Application/chrome.exe %s'
    # Linux
    # chrome_path = '/usr/bin/google-chrome %s'
    webbrowser.get(chrome_path).open(url)

#a = rs.CurveEditPoints(x[1])
# ---------- end send_data ----------
receive_data = GhPythonScript(y=Toggle(False))  # -> out, a; inputs x: list
# ---------- receive_data: Python ----------
__author__ = "drago"
__version__ = "2020.06.02"

import rhinoscriptsyntax as rs
import scriptcontext
import Rhino

if y:
    scriptcontext.doc = ghdoc
    c = rs.AddPolyline(x)
    doc_object = rs.coercecurve(c)
    print(c)
    scriptcontext.doc = Rhino.RhinoDoc.ActiveDoc
    rhino_brep = scriptcontext.doc.Objects.Add(doc_object)
    
    #geometry = doc_object.Geometry
    
    #doc_object = rs.coercerhinoobject(c, True, True)
    
    #scriptcontext.doc = Rhino.RhinoDoc.ActiveDoc
    #rhino_brep = scriptcontext.doc.Objects.Add(geometry, attributes)
    #scriptcontext.doc = Rhino.RhinoDoc.ActiveDoc
    rs.ObjectLayer(rhino_brep, "Layer 02")
    scriptcontext.doc = ghdoc
# ---------- end receive_data ----------
panel = Panel(send_data.b)
