# Grasshopper definition test_data.gh (Grasshopper 1.0.7)

levels = Slider(1, range=1..100)
height = Slider(2.6, range=2.6..5)
ghpython_script = GhPythonScript(levels=levels, height=height)  # -> out, gwp, a, c
# ---------- ghpython_script: Python ----------
__author__ = "drago"
__version__ = "2020.06.25"

import rhinoscriptsyntax as rs
import time
import json
import System.Net.WebClient

webclient = System.Net.WebClient()
output = webclient.DownloadString("http://localhost:5000/get/")

output = []

node1 = {"id":2,"center":[1,1.5,0],"floorArea":6,"roomtype":"P",
        "totalGWP": 34,
       "wall_S":{"composition":[0.5,0.4,0.1],
                "vertices":[[[0,0,0],[1,0,0]],
                            [[1,0,0],[1.8,0,0]],
                            [[1.8,0,0],[2,0,0]]],
                            "material":["CP010","CP011","CP01"],
                            "GWP":[1,2,3],"halved":False},
       "wall_E":{"composition":[0.8,0.2,0],
                "vertices":[[[2,0,0],[2,2.4,0]],
                            [[2,2.4,0],[2,3,0]],
                            [[2,3,0],[2,3,0]]],
                            "material":["CP010","CP011","CP01"],
                            "GWP":[3,-2,0],"halved":False},
       "wall_N":{"composition":[0.2,0.3,0.5],
                "vertices":[[[0,3,0],[0.4,3,0]],
                            [[0.4,3,0],[1,3,0]],
                            [[1,3,0],[2,3,0]]],
                            "material":["CP011","CP011","CP01"],
                            "GWP":[4,5,1],"halved":False},
       "wall_W":{"composition":[0.5,0.4,0.1],
                "vertices":[[[0,0,0],[0,1.5,0]],
                            [[0,1.5,0],[0,2.7,0]],
                            [[0,2.7,0],[0,3,0]]],
                            "material":["CP010","CP011","CP01"],
                            "GWP":[1,2,3],"halved":False}}

node2 = {"id":3,"center":[2.5,1.5,0],"floorArea":3,"roomtype":"P",
        "totalGWP": 34,
       "wall_S":{"composition":[0.5,0.4,0.1],
                "vertices":[[[2,0,0],[2.5,0,0]],
                            [[2.5,0,0],[2.9,0,0]],
                            [[2.9,0,0],[3,0,0]]],
                            "material":["CP010","CP011","CP01"],
                            "GWP":[1,2,3],"halved":False},
       "wall_N":{"composition":[0.2,0.3,0.5],
                "vertices":[[[2,3,0],[2.2,3,0]],
                            [[2.2,3,0],[2.5,3,0]],
                            [[2.5,3,0],[3,3,0]]],
                            "material":["CP011","CP011","CP01"],
                            "GWP":[4,5,1],"halved":False},
       "wall_W":{"composition":[0.5,0.4,0.1],
                "vertices":[[[2,0,0],[2,1.5,0]],
                            [[2,1.5,0],[2,2.7,0]],
                            [[2,2.7,0],[2,3,0]]],
                            "material":["CP010","CP011","CP01"],
                            "GWP":[1,2,3],"halved":False},
       "wall_E":{"composition":[0.8,0.2,0],
                "vertices":[[[3,0,0],[3,2.4,0]],
                            [[3,2.4,0],[3,3,0]],
                            [[3,3,0],[3,3,0]]],
                            "material":["CP010","CP011","CP01"],
                            "GWP":[3,-2,0],"halved":False}}
                            
output = [node1,node2]

#print(output)

a = output[0]["wall_N"]["vertices"]

c = []
gwp = []
    
levels = int(levels)
    
for i in range(0,len(output)):
    north_wall = output[i]["wall_N"]["vertices"]
    north_gwp = output[i]["wall_N"]["GWP"]
    for j in range(0,len(north_wall)):
        if north_wall[j][0]==north_wall[j][1]:
            pass
        else:
            start = north_wall[j][0]
            end = north_wall[j][1]
            for k in range(0,levels):
                start[2] = k*height 
                end[2] = k*height
                c.append(rs.AddPolyline([start,end]))
                gwp.append(north_gwp[j])
            
    south_wall = output[i]["wall_S"]["vertices"]
    south_gwp = output[i]["wall_S"]["GWP"]
    for j in range(0,len(south_wall)):
        if south_wall[j][0]==south_wall[j][1]:
            pass
        else:
            start = south_wall[j][0]
            end = south_wall[j][1]
            for k in range(0,levels):
                start[2] = k*height 
                end[2] = k*height
                c.append(rs.AddPolyline([start,end]))
                gwp.append(south_gwp[j])
            
    west_wall = output[i]["wall_W"]["vertices"]
    west_gwp = output[i]["wall_W"]["GWP"]
    for j in range(0,len(west_wall)):
        if west_wall[j][0]==west_wall[j][1]:
            pass
        else:
            start = west_wall[j][0]
            end = west_wall[j][1]
            for k in range(0,levels):
                start[2] = k*height 
                end[2] = k*height
                c.append(rs.AddPolyline([start,end]))
                gwp.append(west_gwp[j])
                
    east_wall = output[i]["wall_E"]["vertices"]
    east_gwp = output[i]["wall_E"]["GWP"]
    for j in range(0,len(east_wall)):
        if east_wall[j][0]==east_wall[j][1]:
            pass
        else:
            start = east_wall[j][0]
            end = east_wall[j][1]
            for k in range(0,levels):
                start[2] = k*height 
                end[2] = k*height
                c.append(rs.AddPolyline([start,end]))
                gwp.append(east_gwp[j])
# ---------- end ghpython_script ----------
panel = Panel(ghpython_script.gwp)
unit_z = UnitZ(Factor=3)
extrude = Extrude(Base=ghpython_script.c, Direction=unit_z)
panel_2 = Panel(ghpython_script.c)
